# Grasshopper definition PythonCurvesAndSurfaces007.gh (Grasshopper 1.0.7)
# Copyright: Wickerson Studios
# plug-ins: Bifocals

V = Vertices([Point(-4689.076001, -2040.478225, 0), Point(-4583.540454, -1983.340886, 0), Point(-4494.207506, -1896.276528, 0), Point(-4734.117807, -1515.176639, 0), Point(-4616.533541, -1482.684562, 0), Point(-4497, -1472, 0)])
V_2 = Vertices([Point(-4497, -1472, 0), Point(-3960, -1424, 0), Point(-3844, -1946, 0), Point(-3964, -2098.714286, 0)])
nurbs = NurbsCurve(Vertices=V, Degree=3, Periodic=False)  # -> Curve, Length, Domain
nurbs_2 = NurbsCurve(Vertices=V_2, Degree=3, Periodic=False)  # -> Curve, Length, Domain
crv = Curve(reparameterize(nurbs.Curve))
crv_2 = Curve(reparameterize(nurbs_2.Curve))

# ---- group: first curve tangent
cdiv = Derivatives(Curve=crv, Parameter="1")  # -> Point, FirstDerivative

# ---- group: second curve tangent
cdiv_2 = Derivatives(Curve=crv_2, Parameter="0")  # -> Point, FirstDerivative

# ---- group: first curve curvature
curvature = Curvature(Curve=crv, Parameter="1")  # -> P, K, C

# ---- group: second curve curvature
curvature_2 = Curvature(Curve=crv_2, Parameter="0")  # -> P, K, C

# ----
python = PythonScript(c1=crv, c2=crv_2)  # -> out, A; inputs c1: Curve, c2: Curve
# ---------- python: Python ----------
#decalre variables
continuity = ""

#extract start and end points
end_c1 = c1.PointAtEnd
start_c2 = c2.PointAtStart

#check G0 continuity
if end_c1.DistanceTo(start_c2) == 0:
    continuity = "G0"

#check G1 continuity
if continuity == "G0":
    #calculate tangents
    v_c1 = c1.TangentAtEnd
    v_c2 = c2.TangentAtStart
    #unitize tangent vectors
    v_c1.Unitize()
    v_c2.Unitize()
    #compare tangents
    dot = v_c1 * v_c2
    if dot == 1.0:
        continuity = "G1"
    else:
        print("Failed G1")
        print(dot)
        
#check G2 continuity
if continuity == "G1":
    
    #extract the parameter at start and end of the curves domain
    t1 = c1.Domain.Max
    t2 = c2.Domain.Min
    #calculate curvature
    c_c1 = c1.CurvatureAt(t1)
    c_c2 = c2.CurvatureAt(t2)
    #unitize curvature vectors
    c_c1.Unitize()
    c_c2.Unitize()
    #compare vectors
    dot = c_c1 * c_c2
    if dot == 1.0:
        continuity = "G2"
    else:
        print("Failed G2")
        print(dot)
        
#assign output
A = continuity
# ---------- end python ----------
end = EndPoints(Curve=crv)  # -> Start, End
end_2 = EndPoints(Curve=crv_2)  # -> Start, End

# ---- group: compare tangents
dprod = DotProduct(VectorA=cdiv.FirstDerivative, VectorB=cdiv_2.FirstDerivative, Unitize=Toggle(True))
equals = Equality(FirstNumber=dprod, SecondNumber="1")  # -> Equality, Inequality

# ---- group: display tangent
vdis = VectorDisplay(Anchor=[cdiv.Point, cdiv_2.Point], Vector=[cdiv.FirstDerivative, cdiv_2.FirstDerivative])

# ----
panel = Panel(python.A)
vb = VBScript(c1=crv, c2=crv_2)  # -> out, A; inputs c1: Curve, c2: Curve; disabled
# ---------- vb: VB ----------
    'declare variables
    Dim continuity As New String("")
    Dim t1, t2 As Double
    Dim v_c1, v_c2, c_c1, c_c2 As Vector3d

    'extract start and end points
    Dim end_c1 = c1.PointAtEnd
    Dim start_c2 = c2.PointAtStart

    'check G0 continuity
    If end_c1.DistanceTo(start_c2) = 0 Then
      continuity = "G0"
    End If

    'check G1 continuity
    If continuity = "G0" Then
      'calculate tangents
      v_c1 = c1.TangentAtEnd
      v_c2 = c2.TangentAtStart
      'unitize tangent vectors
      v_c1.Unitize
      v_c2.Unitize
      'compare tangents
      If v_c1 * v_c2 = 1.0 Then
        continuity = "G1"
      End If
    End If

    'check G2 continuity
    If continuity = "G1" Then
      'extract the parameter at start and end of the curves domain
      t1 = c1.Domain.Max
      t2 = c2.Domain.Min
      'calculate curvature
      c_c1 = c1.CurvatureAt(t1)
      c_c2 = c2.CurvatureAt(t2)
      'unitize curvature vectors
      c_c1.Unitize
      c_c2.Unitize
      'compare vectors
      If c_c1 * c_c2 = 1.0 Then
        continuity = "G2"
      End If
    End If

    'Assign output
    A = continuity
# ---------- end vb ----------
c_script = CSharpScript(c1=crv, c2=crv_2)  # -> out, A; inputs c1: Curve, c2: Curve; disabled
# ---------- c_script: C# ----------
    //decalre variables
    string continuity = ("");
    double t1, t2;
    Vector3d v_c1, v_c2, c_c1, c_c2;

    //extract start and end points
    Point3d end_c1 = c1.PointAtEnd;
    Point3d start_c2 = c2.PointAtStart;

    //check G0 continuity
    if( end_c1.DistanceTo(start_c2) == 0){
      continuity = "G0";
    }

    //check G1 continuity
    if( continuity == "G0")
    {
      //calculate tangents
      v_c1 = c1.TangentAtEnd;
      v_c2 = c2.TangentAtStart;
      //unitize tangent vectors
      v_c1.Unitize();
      v_c2.Unitize();
      //compare tangents
      if( v_c1 * v_c2 == 1.0 ){
        continuity = "G1";
      }
    }

    //check G2 continuity
    if( continuity == "G1" )
    {
      //extract the parameter at start and end of the curves domain
      t1 = c1.Domain.Max;
      t2 = c2.Domain.Min;
      //calculate curvature
      c_c1 = c1.CurvatureAt(t1);
      c_c2 = c2.CurvatureAt(t2);
      //unitize curvature vectors
      c_c1.Unitize();
      c_c2.Unitize();
      //compare vectors
      if( c_c1 * c_c2 == 1.0 ){
        continuity = "G2";
      }
    }

    //assign output
    A = continuity;
# ---------- end c_script ----------

# ---- group: compare curvature vectors
dprod_2 = DotProduct(VectorA=curvature.K, VectorB=curvature_2.K, Unitize=Toggle(True))
equals_2 = Equality(FirstNumber=dprod_2, SecondNumber="1")  # -> Equality, Inequality

# ---- group: display tangents
amp = Amplitude(Vector=[curvature.K, curvature_2.K], Amplitude=10)
vdis_2 = VectorDisplay(Anchor=[curvature.P, curvature_2.P], Vector=amp)

# ---- group: P2
pt = Point(end_2.Start)

# ---- group: P1
pt_2 = Point(end.End)

# ----
sph = Sphere(Base=PlaneXY(0, 0, 0), Radius="1")
cone = Cone(Base=PlaneXY(0, 0, 0), Radius="1.5", Length="2")  # -> Cone, Tip
sph_2 = Sphere(Base=PlaneXY(0, 0, 0), Radius="1")
cone_2 = Cone(Base=PlaneXY(0, 0, 0), Radius="1.5", Length="2")  # -> Cone, Tip
sph_3 = Sphere(Base=PlaneXY(0, 0, 0), Radius="1")
cone_3 = Cone(Base=PlaneXY(0, 0, 0), Radius="1.5", Length="2")  # -> Cone, Tip
panel_2 = Panel(python.out)
equals_3 = Equality(FirstNumber=pt_2, SecondNumber=pt)  # -> Equality, Inequality
panel_3 = Panel(c_script.A)  # disabled
panel_4 = Panel(vb.A)  # disabled
python_2 = PythonScript(srf=[sph, cone.Cone])  # -> out, A; inputs srf: Brep
# ---------- python_2: Python ----------
#Decalre a new list of points
singular_points = []

#Examine all trims in the input brep
for trim in srf.Trims:

	#Null edge of a trim indicates a singularity
	if trim.Edge == None:
		#Find the 2D parameter space point at trim start or end
		pt2d = trim.PointAtStart
		
		#Evaluate trim end point on the object surface
		pt3d = trim.Face.PointAt(pt2d.X, pt2d.Y)
		
		#Add 3D point to the list of singular points
		singular_points.append(pt3d)
		
#Asign output
A = singular_points
# ---------- end python_2 ----------
vb_2 = VBScript(srf=[sph_3, cone_3.Cone])  # -> out, A; inputs srf: Brep
# ---------- vb_2: VB ----------
    'Decalre a new list of points
    Dim singular_points As New List( Of Point3d)

    'Examine all trims in the input
    For Each trim As BrepTrim In srf.Trims

      'Null edge of a trim indicates a singularity
      If trim.Edge Is Nothing Then

        'Find the 2D parameter space point of the start or end of the trim
        Dim pt2d = New Point2d(trim.PointAtStart)

        'Evaluate trim end point on the object surface
        Dim pt3d = trim.Face.PointAt(pt2d.x, pt2d.y)

        'Add 3D point to the list of singular points
        singular_points.Add(pt3d)
      End If

    Next

    'Asign output
    A = singular_points
# ---------- end vb_2 ----------
c_script_2 = CSharpScript(srf=[sph_2, cone_2.Cone])  # -> out, A; inputs srf: Brep
# ---------- c_script_2: C# ----------
    //Decalre a new list of points
    List < Point3d > singular_points = new List<Point3d>();

    //Examine all trims in the input
    foreach( BrepTrim trim in srf.Trims)
    {
      //Null edge of a trim indicates a singularity
      if( trim.Edge == null)
      {
        //Find the 2D parameter space point of the start or end of the trim
        Point2d pt2d = new Point2d(trim.PointAtStart);

        //Evaluate trim end point on the object surface
        Point3d pt3d = trim.Face.PointAt(pt2d.X, pt2d.Y);

        //Add 3D point to the list of singular points
        singular_points.Add(pt3d);
      }
    }

    //Asign output
    A = singular_points;
# ---------- end c_script_2 ----------
panel_5 = Panel(equals_3.Equality)

# ---- group: G1
bool = Boolean(equals.Equality)

# ---- group: G0
bool_2 = Boolean(equals_3.Equality)

# ---- group: G2
bool_3 = Boolean(equals_2.Equality)

# ---- group: singular points
panel_6 = Panel(python_2.A)

# ----
pt_3 = Point(vb_2.A)
and = GateAnd(A=bool_2, B=bool)

# ---- group: singular points
panel_7 = Panel(vb_2.A)

panel_8 = Panel(c_script_2.A)

# ----
and_2 = GateAnd(A=and, B=bool_3)
merge = Merge(Data1=and_2, Data2=and, Data3=bool_2, Data4="False")
panel_9 = Panel("""G2
G1
G0
Not""")
dispatch = Dispatch(List=panel_9, DispatchPattern=merge)  # -> ListA, ListB
item = ListItem(List=dispatch.ListA, Index="0", Wrap=True)
panel_10 = Panel(item)
