# Grasshopper definition PythonCurvesAndSurfaces008.gh (Grasshopper 1.0.7)
# Copyright: Wickerson Studios

panel = Panel("1")  # disabled
panel_2 = Panel("1.5")  # disabled
panel_3 = Panel("2")  # disabled
panel_4 = Panel("1")  # disabled
panel_5 = Panel("1.5")  # disabled
panel_6 = Panel("2")  # disabled
sph = Sphere(Base=PlaneXY(0, 0, 0), Radius="1")
cone = Cone(Base=PlaneXY(0, 0, 0), Radius="1.5", Length="2")  # -> Cone, Tip
sph_2 = Sphere(Base=PlaneXY(0, 0, 0), Radius=panel)  # disabled
cone_2 = Cone(Base=PlaneXY(0, 0, 0), Radius=panel_2, Length=panel_3)  # -> Cone, Tip; disabled
sph_3 = Sphere(Base=PlaneXY(0, 0, 0), Radius=panel_4)  # disabled
cone_3 = Cone(Base=PlaneXY(0, 0, 0), Radius=panel_5, Length=panel_6)  # -> Cone, Tip; disabled
python = PythonScript(srf=[sph, cone.Cone])  # -> out, A; inputs srf: Brep
# ---------- python: Python ----------
#Decalre a new list of points
singular_points = []

#Examine all trims in the input brep
for trim in srf.Trims:

	#Null edge of a trim indicates a singularity
	if trim.Edge == None:
		#Find the 2D parameter space point at trim start or end
		pt2d = trim.PointAtStart
		
		#Evaluate trim end point on the object surface
		pt3d = trim.Face.PointAt(pt2d.X, pt2d.Y)
		
		#Add 3D point to the list of singular points
		singular_points.append(pt3d)
		
#Asign output
A = singular_points
# ---------- end python ----------
vb = VBScript(srf=[sph_3, cone_3.Cone])  # -> out, A; inputs srf: Brep; disabled
# ---------- vb: VB ----------
    'Decalre a new list of points
    Dim singular_points As New List( Of Point3d)

    'Examine all trims in the input
    For Each trim As BrepTrim In srf.Trims

      'Null edge of a trim indicates a singularity
      If trim.Edge Is Nothing Then

        'Find the 2D parameter space point of the start or end of the trim
        Dim pt2d = New Point2d(trim.PointAtStart)

        'Evaluate trim end point on the object surface
        Dim pt3d = trim.Face.PointAt(pt2d.x, pt2d.y)

        'Add 3D point to the list of singular points
        singular_points.Add(pt3d)
      End If

    Next

    'Asign output
    A = singular_points
# ---------- end vb ----------
c_script = CSharpScript(srf=[sph_2, cone_2.Cone])  # -> out, A; inputs srf: Brep; disabled
# ---------- c_script: C# ----------
    //Decalre a new list of points
    List < Point3d > singular_points = new List<Point3d>();

    //Examine all trims in the input
    foreach( BrepTrim trim in srf.Trims)
    {
      //Null edge of a trim indicates a singularity
      if( trim.Edge == null)
      {
        //Find the 2D parameter space point of the start or end of the trim
        Point2d pt2d = new Point2d(trim.PointAtStart);

        //Evaluate trim end point on the object surface
        Point3d pt3d = trim.Face.PointAt(pt2d.X, pt2d.Y);

        //Add 3D point to the list of singular points
        singular_points.Add(pt3d);
      }
    }

    //Asign output
    A = singular_points;
# ---------- end c_script ----------

# ---- group: singular points
panel_7 = Panel(python.A)

# ----
pt = Point(vb.A)  # disabled

# ---- group: singular points
panel_8 = Panel(vb.A)  # disabled

panel_9 = Panel(c_script.A)  # disabled
