# Grasshopper definition PythonEvalSrf001.gh (Grasshopper 1.0.7)
# Copyright: Wickerson Studios
# plug-ins: Bifocals

vertices = Vertices([Point(13, -76, 0), Point(-79, -30, 0), Point(7, -30, 0), Point(-3, 67, 0), Point(-112, 110, 0), Point(-41, 160, 0)])
nurbs_curve = NurbsCurve(Vertices=vertices, Degree=3, Periodic=False)  # -> Curve, Length, Domain
unit_z = UnitZ(Factor=Slider(100, range=0..100))
extrude = Extrude(Base=nurbs_curve.Curve, Direction=unit_z)
point = Point(Point(58.26692596, 63.87063657, 66.27510822))
surface_closest_point = SurfaceClosestPoint(Point=point, Surface=extrude)  # -> Point, UVPoint, Distance
ghpython_script = GhPythonScript(pt=point, srf=extrude)  # -> out, A, normal
# ---------- ghpython_script: Python ----------
__author__ = "Sculpture"
__version__ = "2020.06.16"

import rhinoscriptsyntax as rs

#find the closest point
u, v = rs.SurfaceClosestPoint(srf, pt)

#get closest point
closest_pt = rs.EvaluateSurface(srf,u,v)

#calculate direction from closest point to test point
dir = rs.PointCoordinates(pt) - closest_pt

#calculate surface normal
normal = rs.SurfaceNormal(srf, [u,v])

#compare the two directions using the dot product
A = dir * normal
# ---------- end ghpython_script ----------
panel = Panel(ghpython_script.A)
vector_2pt = Vector2Pt(PointA=point, PointB=surface_closest_point.Point, Unitize=False)  # -> Vector, Length
amplitude = Amplitude(Vector=ghpython_script.normal, Amplitude=panel)
vector_display = VectorDisplay(Anchor=surface_closest_point.Point, Vector=vector_2pt.Vector)
vector_display_2 = VectorDisplay(Anchor=surface_closest_point.Point, Vector=amplitude)
