# Grasshopper definition PythonExplodedBox002.gh (Grasshopper 1.0.7)
# Copyright: Wickerson Studios
# plug-ins: Bifocals

number_slider = Slider(6, range=0..100)
center_box = CenterBox(Base=PlaneXY(0, 0, 0), X=number_slider, Y=number_slider, Z=number_slider)
python = PythonScript(box=center_box, dis=number_slider)  # -> out, A; inputs box: Brep
# ---------- python: Python ----------
import Rhino

#get the brep center
area = Rhino.Geometry.AreaMassProperties.Compute(box)
box_center = area.Centroid

#get a list of faces
faces = box.Faces

#decalre variables
exploded_faces = []

#loop through all faces
for i, face in enumerate(faces):

	#get a duplicate of the face
	extracted_face = faces.ExtractFace(i)
	
	#get the center of each face
	area = Rhino.Geometry.AreaMassProperties.Compute(extracted_face)
	center = area.Centroid
	
	#calculate move direction (from box centroid to face center)
	dir = center - box_center
	dir.Unitize()
	dir *= dis
	
	#move the extracted face
	move = Rhino.Geometry.Transform.Translation(dir)
	extracted_face.Transform(move)
	
	#add to exploded_faces list
	exploded_faces.append(extracted_face)

#assign exploded list of faces to output
A = exploded_faces
# ---------- end python ----------
geometry = Geometry(python.A)

# ---- group: exploded faces
viewer = ParamViewer(python.A)
