# Grasshopper definition PythonExplodedQuadSphere003.gh (Grasshopper 1.0.7)
# Copyright: Wickerson Studios
# plug-ins: Bifocals

quad_sphere = QuadSphere(Base=PlaneXY(0, 0, 0), Radius=Slider(7, range=0..100))
python = PythonScript(box=quad_sphere, dis=Slider(14, range=0..100))  # -> out, A; inputs box: Brep
# ---------- python: Python ----------
import Rhino

#get the brep center
area = Rhino.Geometry.AreaMassProperties.Compute(box)
box_center = area.Centroid

#get a list of faces
faces = box.Faces

#decalre variables
exploded_faces = []

#loop through all faces
for i, face in enumerate(faces):

	#get a duplicate of the face
	extracted_face = faces.ExtractFace(i)
	
	#get the center of each face
	area = Rhino.Geometry.AreaMassProperties.Compute(extracted_face)
	center = area.Centroid
	
	#calculate move direction (from box centroid to face center)
	dir = center - box_center
	dir.Unitize()
	dir *= dis
	
	#move the extracted face
	move = Rhino.Geometry.Transform.Translation(dir)
	extracted_face.Transform(move)
	
	#add to exploded_faces list
	exploded_faces.append(extracted_face)

#assign exploded list of faces to output
A = exploded_faces
# ---------- end python ----------

# ---- group: exploded faces
viewer = ParamViewer(python.A)

# ----
geometry = Geometry(python.A)
