# Grasshopper definition PythonTangentMatricies001.gh (Grasshopper 1.0.7)
# Copyright: Wickerson Studios
# plug-ins: Bifocals

number_slider = Slider(41, range=0..100)
unit_z = UnitZ(Factor=number_slider)
center_box = CenterBox(Base=PlaneXY(0, 0, 0), X=number_slider, Y=Slider(48, range=0..100), Z=Slider(8, range=0..100))
move = Move(Geometry=center_box, Motion=unit_z)  # -> Geometry, Transform
bounding_box = BoundingBox(Content=move.Geometry, Plane=PlaneXY(0, 0, 0), UnionBox=True)  # -> Box, Box_2
area = Area(Geometry=bounding_box.Box)  # -> Area, Centroid
construct_point = ConstructPoint(XCoordinate=0, YCoordinate=0, ZCoordinate=0)
vector_2pt = Vector2Pt(PointA=area.Centroid, PointB=construct_point, Unitize=False)  # -> Vector, Length
vector_display = VectorDisplay(Anchor=area.Centroid, Vector=vector_2pt.Vector)
