# Grasshopper definition PythonTangentMatricies002.gh (Grasshopper 1.0.7)
# Copyright: Wickerson Studios
# plug-ins: Bifocals

number_slider = Slider(0.4, range=0..1)
pi = Pi(Factor=Slider(0.25, range=0..1))

box = Box([{Plane=PlaneXY(-72, -5, 0), X=Domain(0, 88), Y=Domain(0, 34), Z=Domain(0, 17)}, {Plane=PlaneXY(-83, -97, 0), X=Domain(0, 18), Y=Domain(0, 31), Z=Domain(0, 20)}, {Plane=PlaneXY(25, -49, 0), X=Domain(0, 36), Y=Domain(0, 39), Z=Domain(0, 15)}, {Plane=PlaneXY(-60, -159, 0), X=Domain(0, 64), Y=Domain(0, 139), Z=Domain(0, 12)}])
ghpython_script = GhPythonScript(geom=box, angle=pi, scale=number_slider)  # -> out, A, M; inputs geom: list of GeometryBase
# ---------- ghpython_script: Python ----------
__author__ = "RajaaIssa"
__version__ = "2019.05.30"

import Rhino

#Move to origin, find center
center = Rhino.Geometry.Point3d.Unset
if geom.Count > 0:
    bbox = geom[0].GetBoundingBox(True)
    for i in range(1, geom.Count):
        bbox.Union(geom[i].GetBoundingBox(True))
    center = bbox.Center

origin = Rhino.Geometry.Point3d.Origin
#Create move transformation matrix
m1 = Rhino.Geometry.Transform.Translation(origin - center)
#Create rotation transformation matrix
m2 = Rhino.Geometry.Transform.Rotation(angle, origin)
#Create scale transformation matrix
m3 = Rhino.Geometry.Transform.Scale(origin, scale)
#Create move back transformation matrix
m4 = Rhino.Geometry.Transform.Identity
result, m4 = m1.TryGetInverse()

#Multiply from last to first transformation
matrix = m4 * m3 * m2 * m1

#Apply transformation to all input geometry
for g in geom:
    g.Transform(matrix)

#Assign output
M = matrix
A = geom
# ---------- end ghpython_script ----------
display_matrix = DisplayMatrix(ghpython_script.M)

number_slider_2 = Slider(32, range=0..100)
center_box = CenterBox(Base=PlaneXY(0, 0, 0), X=Slider(23, range=0..100), Y=number_slider_2, Z=Slider(3, range=0..100))
construct_point = ConstructPoint(XCoordinate=0, YCoordinate=0, ZCoordinate=0)

unit_z = UnitZ(Factor=number_slider_2)
move = Move(Geometry=center_box, Motion=unit_z)  # -> Geometry, Transform

bounding_box = BoundingBox(Content=move.Geometry, Plane=PlaneXY(0, 0, 0), UnionBox=True)  # -> Box, Box_2
area = Area(Geometry=bounding_box.Box)  # -> Area, Centroid
vector_2pt = Vector2Pt(PointA=area.Centroid, PointB=construct_point, Unitize=False)  # -> Vector, Length
vector_display = VectorDisplay(Anchor=area.Centroid, Vector=vector_2pt.Vector)

vector = Vector(vector_2pt.Vector)
move_2 = Move(Geometry=bounding_box.Box, Motion=vector)  # -> Geometry, Transform
rotate = Rotate(Geometry=bounding_box.Box, Angle=pi, Plane=PlaneXY(0, 0, 0))  # -> Geometry, Transform
inverse_transform = InverseTransform(Transform=move_2.Transform)
scale = Scale(Geometry=bounding_box.Box, Center=Point(0, 0, 0), Factor=number_slider)  # -> Geometry, Transform
display_matrix_2 = DisplayMatrix(inverse_transform)
display_matrix_3 = DisplayMatrix(rotate.Transform)
display_matrix_4 = DisplayMatrix(scale.Transform)
display_matrix_5 = DisplayMatrix(move_2.Transform)
