# Grasshopper definition PythonTangentSpheres005.gh (Grasshopper 1.0.7)
# Copyright: Wickerson Studios
# plug-ins: Bifocals

number_slider = Slider(0.56, range=0..1)
point = Point([<point referenced from the Rhino model> x6])
point_2 = Point(<point referenced from the Rhino model>)
expression = Expression(A=point, B=point_2, t=number_slider, Expression="A + t * (B-A)")
expression_2 = Expression(A=point, D=expression, t=number_slider, Expression="A + 0.5 * (D - A)")
expression_3 = Expression(D=expression, B=point_2, t=number_slider, Expression="D + 0.5 * (B-D)")
distance = Distance(PointA=point, PointB=expression_2)
distance_2 = Distance(PointA=expression_3, PointB=point_2)
plane_normal = PlaneNormal(Origin=[expression_2, expression_3], ZAxis=Vector(0, 0, 1))
sphere = Sphere(Base=plane_normal, Radius=[distance, distance_2])
