# Grasshopper definition PythonTangentSpheres006.gh (Grasshopper 1.0.7)
# Copyright: Wickerson Studios
# plug-ins: Bifocals

number_slider = Slider(0.61, range=0..1)
point = Point(Point(30, -19, 0))
point_2 = Point([Point(-6, 13, 0), Point(30, -19, 0), Point(4, 86, 0), Point(47, 62, 0), Point(8, -37, 0), Point(-15, -26, 0)])
expression = Expression(A=point_2, B=point, t=number_slider, Expression="A + t * (B-A)")
expression_2 = Expression(A=point_2, D=expression, t=number_slider, Expression="A + 0.5 * (D - A)")
expression_3 = Expression(D=expression, B=point, t=number_slider, Expression="D + 0.5 * (B-D)")
distance = Distance(PointA=point_2, PointB=expression_2)
distance_2 = Distance(PointA=expression_3, PointB=point)
plane_normal = PlaneNormal(Origin=[expression_2, expression_3], ZAxis=Vector(0, 0, 1))
sphere = Sphere(Base=plane_normal, Radius=[distance, distance_2])

number_slider_2 = Slider(0.76, range=0..1)
point_3 = Point(Point(30, -19, 0))
point_4 = Point(Point(4, 86, 0))
python = PythonScript(A=point_4, B=point_3, t=number_slider)  # -> out, S1, S2; inputs A: Point3d, B: Point3d
# ---------- python: Python ----------
import Rhino

#find a point between A and B
D = A + t * (B - A)

#find mid point between A and D
C1 = A + 0.5 * (D - A)

#find mid point between D and B
C2 = D + 0.5 * (B - D)

#find spheres radius
r1 = A.DistanceTo(C1)
r2 = B.DistanceTo(C2)

#create spheres and assign to output
S1 = Rhino.Geometry.Sphere(C1, r1)
S2 = Rhino.Geometry.Sphere(C2, r2)
# ---------- end python ----------
geometry = Geometry(python.S1)
geometry_2 = Geometry(python.S2)
